# Grasshopper definition mask_maker.gh (Grasshopper 1.0.8)
# plug-ins: Imaging Library, RhinoCodePluginGH, Pufferfish

pipeline = GeometryPipeline(
    GroupByLayer=False,
    GroupByType=False,
    IncludeHidden=True,
    IncludeLocked=True,
    LayerFilter="*",
    NameFilter="*",
    SublayerFiltering=True,
    TypeFilter=4)
number_slider = Slider(3.145, range=0..10)
len = Length(Curve=pipeline)
number_slider_2 = Slider(2, range=0..2)
pipeline_2 = GeometryPipeline(
    GroupByLayer=False,
    GroupByType=False,
    IncludeHidden=True,
    IncludeLocked=True,
    LayerFilter="*",
    NameFilter="*",
    SublayerFiltering=True,
    TypeFilter=1073741848)
smaller = SmallerThan(FirstNumber=len, SecondNumber=Slider(0.152, range=0..1))  # -> SmallerThan, OrEqualTo
cull = CullPattern(List=pipeline, CullPattern=invert(smaller.OrEqualTo))
crv = Curve(cull)

# ---- group: Outlining the strokes
number_slider_3 = Slider(0.05, range=0..1)
offcrv = OffsetCurve(
    Curve=crv,
    Plane=PlaneXY(0, 0, 0),
    Distance=number_slider_3,
    BothSides=expr("x*-1", number_slider_3),
    Kinks=Slider(2, range=0..10),
    CapType=Slider(3, range=0..10))  # -> flatten(Offset)

# ----
# Note: We assume that the parent path already has the folders Cut Profile Contour Detail
button = Button()

# ---- group: Parent path to save images
path = FilePath("C:\Users\andre\Documents\github\auto-lineweights\datasets\dataset5\")

# ---- group: The offset strokes
crv_2 = Curve(offcrv)

# ---- group: The Normal Map Image as Picture/Surface
srf = Surface(pipeline_2)

# ----
py3 = Python3Script(run=button)  # -> out, drawing_name
# ---------- py3: Python ----------
if run == True:
    from Rhino import RhinoDoc
    a  = RhinoDoc.ActiveDoc.Path
    # print(a)
    x = a.rpartition("\\")[2]
    # main_location = a.rpartition("\\")[0]
    #print(x[:-4])
    drawing_name = x[:-4]
# ---------- end py3 ----------
panel = Panel(py3.drawing_name)

# ---- group: Orientation issues
drec = DeconstuctRectangle(Rectangle=srf)  # -> BasePlane, XInterval, YInterval
rectangle = Rectangle(Plane=drec.BasePlane, XSize=drec.YInterval, YSize=drec.XInterval, Radius=0)  # -> Rectangle, Length
area = Area(Geometry=rectangle.Rectangle)  # -> Area, Centroid
rotate = Rotate(Geometry=rectangle.Rectangle, Angle=1.570796327, Plane=area.Centroid)  # -> Geometry, Transform

# ----
edges = BrepEdges(Brep=srf)  # -> Naked, Interior, NonManifold
# NEW to this script: Added invalid category for curves that we want to ignore
getlabel = GetLabel(object_or_attributes=crv)

# ---- group: length
item = ListItem(List=edges.Naked, Index=1, Wrap=True)

# ---- group: width
item_2 = ListItem(List=edges.Naked, Index=0, Wrap=True)

# ----
id = Guid(crv)
len_2 = Length(Curve=item_2)

panel_2 = Panel(len_2)
division = Division(A=Slider(2550, range=0..10000), B=panel_2)

fill = CreateGdiFill(Colour=RGB(255, 255, 255))
panel_3 = Panel(id)
py3_2 = Python3Script(x=panel_3, y=path, z=py3.drawing_name, u=getlabel, run=button)  # -> out, a; inputs x: list, y: String, u: list of String
# ---------- py3_2: Python ----------
if run:
    # Create Profile Contour Detail Cut folders if they don't exist
    # at the current directory
    import os

    if not os.path.exists(y + "\\" + "Profile"):
        os.makedirs(y + "\\" + "Profile")

    if not os.path.exists(y + "\\" + "Contour"):
        os.makedirs(y + "\\" + "Contour")

    if not os.path.exists(y + "\\" + "Detail"):
        os.makedirs(y + "\\" + "Detail")

    if not os.path.exists(y + "\\" + "Cut"):
        os.makedirs(y + "\\" + "Cut")
    
    if not os.path.exists(y + "\\" + "Invalid"):
        os.makedirs(y + "\\" + "Invalid")

    a = []
    for i in range(len(x)):
        # print(x[i])
        # print(y)
        # Path \\ drawingName_curveID.jpg
        # print(u)
        a.append(y + "\\" + u[i] + "\\" + z + "_" + x[i] + ".jpg")
# ---------- end py3_2 ----------
panel_4 = Panel(py3_2.a)
complex = CreateGdiComplex(Geometry=crv_2, Fills=fill, Order=True)  # -> graft(Shape)
colour = ColourPicker(PickedColour=RGB(0, 0, 0))
draw = DrawImage(Shapes=complex, Size=rotate.Geometry, Factor=division, Background=colour, AntiAlias=True, FileLocation=graft(py3_2.a))

# ==== cluster GetLabel
object_or_attributes = ClusterInput()
object_attributes = ObjectAttributes(ObjectOrAttributes=object_or_attributes)  # -> Name, LayerName, LayerFullPath, Color, MaterialName, LinetypeName, GroupIndices, PlotWeight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
colortolabel = Python3Script(x=object_attributes.Color)  # -> out, a; inputs x: list
# ---------- colortolabel: Python ----------
import rhinoscriptsyntax as rs
profile = rs.CreateColor(255, 0, 0)
contour = rs.CreateColor(0, 255, 0)
detail = rs.CreateColor(0, 0, 255)
cut = rs.CreateColor(255, 0, 255)

def colorEqual(col1, col2):
    if str(col1) == str(col2):
        return True
    else:
        return False

a = []
for i in range(len(x)):
    if colorEqual(x[i], profile):
        a.append("Profile")
    elif colorEqual(x[i], contour):
        a.append("Contour")
    elif colorEqual(x[i], detail):
        a.append("Detail")
    elif colorEqual(x[i], cut):
        a.append("Cut")
    else:
        a.append("Invalid")
# ---------- end colortolabel ----------
a = ClusterOutput(colortolabel.a)
